# Grasshopper definition first.gh (Grasshopper 1.0.8)

pt = ConstructPoint(XCoordinate=Slider(31.52, range=0..100), YCoordinate=Slider(91.6, range=0..150), ZCoordinate=Slider(10, range=0..100))
dots = DotDisplay(Point=pt, Colour=RGB(0, 0, 0), Size=5)
